# Grasshopper definition pfi_catenaria_idea.gh (Grasshopper 1.0.7)
# plug-ins: Weaverbird, Kangaroo2 Components, MeshEdit Components, Fologram For Grasshopper Utilities, Bowerbird2, Pufferfish

number_slider = Slider(200, range=100..400)  # disabled
# Clase_2
# Catenaria (que épico)
number_slider_2 = Slider(200, range=100..400)  # disabled
X = UnitX(Factor=Slider(4125, range=0..10000))
# Construccion del plano
planesrf = PlaneSurface(Plane=PlaneXY(0, 0, 0), XSize=number_slider_2, YSize=number_slider)  # disabled
crv = Curve(<curve referenced from the Rhino model>)
# Catenaria
crv_2 = Curve(<curve referenced from the Rhino model>)
X_2 = UnitX(Factor=Slider(4480, range=0..10000))
neg = Negative(Value=X)
number_slider_3 = Slider(10, range=1..20)  # disabled
number_slider_4 = Slider(10, range=1..20)  # disabled
move = Move(Geometry=crv_2, Motion=X_2)  # -> Geometry, Transform
move_2 = Move(Geometry=crv, Motion=neg)  # -> Geometry, Transform
loft = Loft(
    Curves=[crv, move_2.Geometry],
    Options={Adjust=False, Closed=False, LoftEnds=0, LoftSimp=0, LoftType=0, Rebuild=10, Refit=0.01})
loft_2 = Loft(Curves=[crv_2, crv], Options={Adjust=False, Closed=False, LoftEnds=0, LoftSimp=0, LoftType=0, Rebuild=10, Refit=0.01})
loft_3 = Loft(
    Curves=[crv_2, move.Geometry],
    Options={Adjust=False, Closed=False, LoftEnds=0, LoftSimp=0, LoftType=0, Rebuild=10, Refit=0.01})
mplane = MeshPlane(Boundary=planesrf, WidthCount=number_slider_4, HeightCount=number_slider_3)  # -> Mesh, Area; disabled
srf = Surface(<surface referenced from the Rhino model>)
srf_2 = Surface(<surface referenced from the Rhino model>)
split = SplitBrep(Brep=loft, Cutter=srf)
split_2 = SplitBrep(Brep=loft_3, Cutter=srf_2)
srf_3 = Surface(<surface referenced from the Rhino model>)
item = ListItem(List=split, Index=0, Wrap=True)
item_2 = ListItem(List=split_2, Index=0, Wrap=True)

number_slider_5 = Slider(48, range=0..120)  # disabled
number_slider_6 = Slider(60, range=0..120)  # disabled
number_slider_7 = Slider(71, range=0..120)  # disabled
number_slider_8 = Slider(91, range=0..120)  # disabled

# ----
# Gene pool
genes = GenePool(Decimals=0, Maximum=120, Minimum=0, Value=[60, 96, 30, 90, 24])  # disabled
join = BrepJoin(Breps=flatten([srf_3, item_2, item]))  # -> Breps, Closed
# Extracción de partes del plano
wbedges = WeaverbirdsMeshEdges(MeshOrPolylines=mplane.Mesh)  # disabled
demesh = DeconstructMesh(Mesh=mplane.Mesh)  # -> Vertices, Faces, Colours, Normals; disabled
# Esquinas seleccionadas
# para fijar
mc = MeshCorners(Mesh=mplane.Mesh, Angle=2.35619449)  # disabled
mesh = MeshBrep(
    Brep=join.Breps,
    Settings={GridMaxCount=0, GridMinCount=16, JaggedSeams=False, MaxEdgeLength=0, MinEdgeLength=0.0001, MinTolerance=0, Refine=True, RefineAngle=0, RelativeTolerance=0.65, SimplePlanes=True, Tolerance=0})
number_slider_9 = Slider(4, range=0..10)  # disabled
qrmesh = QuadRemesh(Mesh=mesh, Settings={aqc=True, as=50, dhe=True, gci=0, null=False, pme=0, sa=0, tqc=2000})
puntos_anclaje = GenePool(Decimals=0, Maximum=4029, Minimum=0, Value=[3522, 3565, 875, 1753, 2028, 1605, 747])
number_slider_10 = Slider(21, range=0..100)  # disabled
puntos_anclaje_2 = GenePool(Decimals=0, Maximum=4029, Minimum=0, Value=[3027, 2402, 3338, 639, 3385, 3429, 3450])
# Punto "i" seleccionado
# para fijar
item_3 = ListItem(List=demesh.Vertices, Index=[genes, number_slider_6, number_slider_7, number_slider_5, number_slider_8], Wrap=True)  # disabled
# Número del largo
# de las líneas extraidas
# de la malla
len = Length(Curve=wbedges)  # disabled
Z = UnitZ(Factor=1)  # disabled
item_4 = ListItem(List=demesh.Vertices, Index=0, Wrap=True)  # disabled
points = PointList(Points=demesh.Vertices, Size=number_slider_9)  # disabled
demesh_2 = DeconstructMesh(Mesh=qrmesh)  # -> Vertices, Faces, Colours, Normals
puntos_anclaje_3 = GenePool(
    Decimals=0,
    Maximum=4029,
    Minimum=0,
    Value=[2821, 2677, 3610, 3598, 3483, 3897, 3509, 3854, 2172, 3425, 130, 605, 1051, 741])
wbedges_2 = WeaverbirdsMeshEdges(MeshOrPolylines=qrmesh)
neg_2 = Negative()  # disabled
Z_2 = UnitZ(Factor=number_slider_10)  # disabled
move_3 = Move(Geometry=item_3, Motion=Z_2)  # -> Geometry, Transform; disabled
len_2 = Length(Curve=wbedges_2)
# fuerzas y restricciones
# (goals)
length_line = LengthLine(Line=wbedges, Length=len, Strength=10)  # disabled
# Carga (que será aplicada
# en los vertices de la malla)
anchor = Anchor(Point=[mc, item_4, move_3.Geometry, item_3], Strength=10000)  # disabled
item_5 = ListItem(List=flatten(demesh_2.Vertices), Index=puntos_anclaje, Wrap=True)
load = Load(Point=demesh.Vertices, ForceVector=Z, Weighting=1)  # disabled
item_6 = ListItem(List=flatten(demesh_2.Vertices), Index=puntos_anclaje_2, Wrap=True)
# Ancla
show = Show(G=mplane.Mesh)  # disabled
item_7 = ListItem(List=flatten(demesh_2.Vertices), Index=puntos_anclaje_3, Wrap=True)
Z_3 = UnitZ(Factor=Slider(8, range=0..100))

# ---- group: Puntos Suelo
anchor_2 = Anchor(Point=item_7, Strength=Slider(100, range=0..100))

# ----
length_line_2 = LengthLine(Line=wbedges_2, Length=len_2, Strength=Slider(10, range=0..100))
load_2 = Load(Point=demesh_2.Vertices, ForceVector=Z_3, Weighting=1)
show_2 = Show(G=qrmesh)
intcrv = Interpolate(Vertices=item_6, Degree=3, Periodic=False, KnotStyle=1)  # -> Curve, Length, Domain
intcrv_2 = Interpolate(Vertices=item_5, Degree=3, Periodic=False, KnotStyle=1)  # -> Curve, Length, Domain
merge = Merge(Data1=length_line, Data2=load, Data3=anchor, Data4=show)  # disabled
toggle = BooleanToggle(False)  # disabled
toggle_2 = BooleanToggle(True)  # disabled
divide = DivideCurve(Curve=intcrv.Curve, Count=Slider(11, range=0..100), Kinks=False)  # -> reverse(Points), Tangents, Parameters
divide_2 = DivideCurve(Curve=intcrv_2.Curve, Count=Slider(11, range=0..100), Kinks=False)  # -> Points, Tangents, Parameters
bouncysolver = BouncySolver(GoalObjects=merge, Reset=toggle, Threshold=1e-15, Tolerance=0.01, Damping=0.99, Iterations=10, On=toggle_2)  # -> I, V, O; disabled
merge_2 = Merge(Data1=anchor_2, Data2=load_2, Data3=length_line_2, Data4=show_2)  # -> flatten(Result)
# Visualización
intcrv_3 = Interpolate(Degree=3, Periodic=False, KnotStyle=1)  # -> Curve, Length, Domain
ln = Line(StartPoint=divide_2.Points, EndPoint=divide.Points)
len_3 = Length(Curve=ln)

# ---- group: K verga
dom = ConstructDomain(DomainStart=Slider(2, range=0..10), DomainEnd=Slider(2, range=0..10))
range = Range(Domain=dom, Steps=divide.Tangents)

# ----
# De los puntos, líneas y
# mallas, solo selecciona las
# mallas (no es que esté malo)
mesh_2 = Mesh(bouncysolver.O)  # disabled
bouncysolver_2 = BouncySolver(GoalObjects=merge_2, Reset=Button(), Threshold=1e-15, Tolerance=0.0001, Damping=0.99, Iterations=10, On=Toggle(True))  # -> I, V, O; disabled
panel = Panel(mesh_2)  # disabled
multiplication = Multiplication(A=len_3, B=range)
Z_4 = UnitZ(Factor=1)
tri = Triangulate(Mesh=mesh_2)  # -> flatten(Mesh), Count; disabled
panel_2 = Panel(tri.Mesh)  # disabled
cat = Catenary(PointA=divide_2.Points, PointB=divide.Points, Length=multiplication, Gravity=Z_4)
# Triangulización
number_slider_11 = Slider(252, range=0..500)  # disabled
crv_3 = Curve(cat)
clean = CleanTree(RemoveNulls=True, RemoveInvalid=True, RemoveEmpty=False, Tree=tri.Mesh)  # disabled
X_3 = UnitX(Factor=number_slider_11)  # disabled
number_slider_12 = Slider(30, range=0..200)  # disabled
number_slider_13 = Slider(93, range=0..100)  # disabled
loft_4 = Loft(Curves=crv_3, Options={Adjust=True, Closed=False, LoftEnds=0, LoftSimp=1, LoftType=1, Rebuild=10, Refit=0.01})
mpipe = MeshPipe(Polylines=cat, NumberOfSides=4, Tolerance=0.1, Radius=Slider(8, range=0..10), Cap=False, Join=False)
panel_3 = Panel(clean)  # disabled
explode = MeshExplode(Mesh=clean, Interpolate=False)  # disabled
move_4 = Move(Geometry=clean, Motion=X_3)  # -> Geometry, Transform; disabled
mesh_3 = MeshBrep(
    Brep=loft_4,
    Settings={GridMaxCount=0, GridMinCount=16, JaggedSeams=False, MaxEdgeLength=0, MinEdgeLength=0.0001, MinTolerance=0, Refine=True, RefineAngle=0, RelativeTolerance=0.65, SimplePlanes=True, Tolerance=0})
neg_3 = Negative(Value=Slider(30, range=0..100))
preview = CustomPreview(
    Geometry=move_4.Geometry,
    Material={diffuse=RGB(221, 160, 221), emission=RGB(66, 48, 66), shine=0.5, specular=RGB(255, 255, 255), transparency=0})  # disabled
reduce = RandomReduce(List=explode, Reduction=number_slider_12, Seed=number_slider_13)  # disabled
offmsh = OffsetMesh(Mesh=mesh_3, Distance=neg_3, BothSides=0, CreateSolid=True)
demesh_3 = DeconstructMesh(Mesh=reduce)  # -> Vertices, Faces, Colours, Normals; disabled
bbwaffle = BBWaffle(
    Mesh=offmsh,
    CountX=Slider(29, range=0..100),
    CountY=Slider(15, range=0..100),
    Thickness=Slider(8, range=0..100),
    Plane=PlaneXY(0, 0, 0),
    Deeper=0,
    Project=Toggle(False),
    Distance=1)  # -> SlicesU, SlicesV, SectionPlanesU, SectionPlanesV
deface = DeconstructFace(Face=demesh_3.Faces)  # -> CornerA, CornerB, CornerC, CornerD; disabled
boundary_surfaces = BoundarySurfaces(Edges=bbwaffle.SlicesU)
boundary_surfaces_2 = BoundarySurfaces(Edges=bbwaffle.SlicesV)
clean_tree = CleanTree(RemoveNulls=True, RemoveInvalid=True, RemoveEmpty=False, Tree=boundary_surfaces)
item_8 = ListItem(List=demesh_3.Vertices, Index=deface.CornerB, Wrap=True)  # disabled
# Lo que quiero lograr
item_9 = ListItem(List=demesh_3.Vertices, Index=deface.CornerD, Wrap=True)  # disabled
item_10 = ListItem(List=demesh_3.Vertices, Index=deface.CornerC, Wrap=True)  # disabled
item_11 = ListItem(List=demesh_3.Vertices, Index=deface.CornerA, Wrap=True)  # disabled
clean_tree_2 = CleanTree(RemoveNulls=True, RemoveInvalid=True, RemoveEmpty=False, Tree=boundary_surfaces_2)
srf4pt = _4PointSurface(CornerA=item_11, CornerB=item_8, CornerC=item_10)  # -> simplify(Surface); disabled
area = Area(Geometry=clean_tree)  # -> Area, Centroid
area_2 = Area(Geometry=clean_tree_2)  # -> Area, Centroid
list_length = ListLength(List=flatten(clean_tree))
area_3 = Area(Geometry=reduce)  # -> Area, Centroid; disabled
list_length_2 = ListLength(List=flatten(clean_tree_2))
panel_4 = Panel(srf4pt)  # disabled
wires = BrepWireframe(Brep=srf4pt, Density=-1)  # disabled
surface_closest_point = SurfaceClosestPoint(Point=area.Centroid, Surface=clean_tree)  # -> Point, UVPoint, Distance
number_slider_14 = Slider(0.22, range=0.09..0.9)  # disabled
number_slider_15 = Slider(0.6, range=0.1..1.1)  # disabled
surface_closest_point_2 = SurfaceClosestPoint(Point=area_2.Centroid, Surface=clean_tree_2)  # -> Point, UVPoint, Distance
number_slider_16 = Slider(5, range=0..10)  # disabled
number_slider_17 = Slider(9, range=0..100)  # disabled
number_slider_18 = Slider(59, range=0..100)  # disabled
series = Series(Start="1", Step="1", Count=list_length)
evaluate_surface = EvaluateSurface(Surface=clean_tree, Point=surface_closest_point.UVPoint)  # -> Point, Normal, UDirection, VDirection, Frame
dom_2 = ConstructDomain(DomainStart=number_slider_14, DomainEnd=number_slider_15)  # disabled
join_2 = JoinCurves(Curves=wires, Preserve=False)  # -> flatten(Curves); disabled
evaluate_surface_2 = EvaluateSurface(Surface=clean_tree_2, Point=surface_closest_point_2.UVPoint)  # -> Point, Normal, UDirection, VDirection, Frame
series_2 = Series(Start="1", Step="1", Count=list_length_2)
dom_3 = ConstructDomain(DomainStart=number_slider_16, DomainEnd=number_slider_17)  # disabled
lng = ListLength(List=join_2)  # disabled
random = Random(Range=dom_3, Number=lng, Seed=number_slider_18)  # disabled
random_2 = Random(Range=dom_2, Number=lng, Seed=number_slider_18)  # disabled
scale = Scale(Geometry=join_2, Center=area_3.Centroid, Factor=random_2)  # -> Geometry, Transform; disabled
Z_5 = UnitZ(Factor=random)  # disabled
bbtext = BBText(
    Location=flatten(evaluate_surface.Frame),
    Text=series,
    Size=Slider(6, range=0..100),
    Bold=False,
    HorizontalAlignment=0,
    VerticalAlignment=0)
bbtext_2 = BBText(
    Location=flatten(evaluate_surface_2.Frame),
    Text=series_2,
    Size=Slider(6, range=0..100),
    Bold=False,
    HorizontalAlignment=0,
    VerticalAlignment=0)
move_5 = Move(Geometry=scale.Geometry, Motion=Z_5)  # -> Geometry, Transform; disabled
number_slider_19 = Slider(6, range=0..10)  # disabled
number_slider_20 = Slider(22, range=0..100)  # disabled
wires_2 = BrepWireframe(Brep=move_5.Geometry, Density=-1)  # disabled
number_slider_21 = Slider(147, range=0..1000)  # disabled
join_3 = JoinCurves(Curves=wires, Preserve=False)  # disabled
number_slider_22 = Slider(4, range=0..10)  # disabled
join_4 = JoinCurves(Curves=wires_2, Preserve=False)  # disabled
lng_2 = ListLength(List=join_3)  # disabled
dom_4 = ConstructDomain(DomainStart=number_slider_19, DomainEnd=number_slider_20)  # disabled
number_slider_23 = Slider(6, range=0..10)  # disabled
loft_5 = Loft(Curves=[join_4, join_3], Options={Adjust=True, Closed=False, LoftEnds=0, LoftSimp=0, LoftType=0, Rebuild=10, Refit=0.01})  # disabled
random_3 = Random(Range=dom_4, Number=number_slider_21, Seed=number_slider_22)  # -> graft(Random); disabled
Z_6 = UnitZ(Factor=random_3)  # disabled
panel_5 = Panel(random_3)  # disabled
extr = Extrude(Base=join_3, Direction=Z_6)  # disabled
cap = CapHoles(Brep=extr)  # disabled
preview_2 = CustomPreview(
    Geometry=cap,
    Material={diffuse=RGB(221, 160, 221), emission=RGB(66, 48, 66), shine=0.5, specular=RGB(255, 255, 255), transparency=0})  # disabled
