# Grasshopper definition uai_3_pd_campos.gh (Grasshopper 1.0.7)

# Rectángulo límite
crv = Curve(<curve referenced from the Rhino model>)

# ----
# Endpoint es dirección
# que puedo modificar, para
# así crear una línea que
# representa la dirección
# de la fuerza
md_slider = MDSlider(
    SliderMode=0,
    slider_value=Point(0.8016946374, 0.7910997344, 0.5),
    x_domain=Domain(0, 1),
    y_domain=Domain(0, 1),
    z_domain=Domain(0, 1))
pt = ConstructPoint(XCoordinate=0, YCoordinate=0, ZCoordinate=0)
ln = Line(StartPoint=pt, EndPoint=md_slider)
fvector = VectorForce(Line=ln, Bounds=crv)

# ----
# 5 ptos carga
genes = GenePool(Decimals=0, Maximum=5, Minimum=-5, Value=[3, -4, 1, 5, -2])
pt_2 = Point([<point referenced from the Rhino model> x5])
pcharge = PointCharge(Point=pt_2, Charge=genes, Decay=2, Bounds=crv)

# ----
# 1 pto giro
number_slider = Slider(10, range=0..10)
# Jorge
pt_3 = Point(<point referenced from the Rhino model>)
fspin = SpinForce(Plane=pt_3, Strength=number_slider, Radius=5, Decay=2, Bounds=crv)

# ----
# Dominio es el rectángulo
# límite, solo que así se usan
# solo las medidas
# Crear grilla en base a
# rango de números/ptos
number_slider_2 = Slider(18, range=0..100)
range = Range(Domain="0 to 20", Steps=number_slider_2)
pt_4 = ConstructPoint(XCoordinate=graft(range), YCoordinate=range, ZCoordinate=0)

cir = Circle(Plane=pt_2, Radius=1)
divide = DivideCurve(Curve=cir, Count=Slider(20, range=0..100), Kinks=False)  # -> Points, Tangents, Parameters
# Campo con:
# 
# ptos de círculos de cargas
#                       +
#          Grilla creada
pt_5 = Point([divide.Points, pt_4])
mergef = MergeFields(Fields=[fvector, fspin, pcharge])
fline = FieldLine(Field=mergef, Point=flatten(pt_5), Steps=Slider(43, range=10..100), Accuracy=0.1, Method=3)
evf = EvaluateField(Field=mergef, Point=flatten(pt_5))  # -> Tensor, Strength
smaller = SmallerThan(FirstNumber=evf.Strength, SecondNumber=Slider(4.47, range=0..10))  # -> SmallerThan, OrEqualTo
# Optimizar líneas
# (tienen más puntos
# que el diablo
# dicen por ahí)
panel = Panel("3")
reb = RebuildCurve(Curve=fline, Degree=panel, Count=Slider(50, range=0..100), Tangents=False)
# lista
# Condición
cull = CullPattern(List=evf.Strength, CullPattern=smaller.SmallerThan)
bnd = Bounds(Numbers=cull)
dedomain = DeconstructDomain(Domain=bnd)  # -> Start, End
gradient = Gradient(
    LowerLimit=dedomain.Start,
    UpperLimit=dedomain.End,
    Parameter=evf.Tensor,
    stops=[0: RGB(0, 128, 0), 0.5: RGB(255, 255, 0), 1: RGB(255, 0, 0)])
preview = CustomPreview(Geometry=reb, Material=gradient)
