# Grasshopper definition uai_3_pd_coocoin.gh (Grasshopper 1.0.7)
# plug-ins: MarchingCubes, Weaverbird, Pufferfish

# 1
number_slider = Slider(1000, range=0..1000)
# 2
number_slider_2 = Slider(1000, range=0..1000)
# 3
number_slider_3 = Slider(1000, range=0..1000)
box = CenterBox(Base=PlaneXY(0, 0, 0), X=number_slider, Y=Slider(1000, range=0..1000), Z=Slider(1000, range=0..1000))
number_slider_4 = Slider(7, range=0..100)

# ---- group: Radios random
dom = ConstructDomain(DomainStart=Slider(500, range=0..1000), DomainEnd=Slider(1000, range=0..10000))
random = Random(Range=dom, Number=number_slider_4, Seed=Slider(500, range=0..501))
panel = Panel(random)

# ----
box_2 = CenterBox(Base=PlaneXY(0, 0, 0), X=number_slider_2, Y=Slider(1000, range=0..1000), Z=Slider(1000, range=0..1000))
box_3 = CenterBox(Base=PlaneXY(0, 0, 0), X=number_slider_3, Y=number_slider_3, Z=Slider(500, range=0..1000))
debrep = DeconstructBrep(Brep=box_2)  # -> Faces, Edges, Vertices

# ----
# y así... (forma larga)
number_slider_5 = Slider(0, range=0..5)
item = ListItem(List=debrep.Faces, Index=number_slider_5, Wrap=True)
item_2 = ListItem(List=debrep.Faces, Index=Slider(1, range=0..5), Wrap=True)

pop3d = Populate3D(Region=box, Count=number_slider_4, Seed=Slider(21, range=0..100))
# Es una secuencia numérica
# 
# D: Dominio (de qué número hasta cuál número)
# 
# N: En cuánto en cuánto
range = Range(Domain=Domain(0, 1), Steps=Slider(6, range=0..10))
range_2 = Range(Domain=Domain(0, 1), Steps=Slider(5, range=0..10))
range_3 = Range(Domain=Domain(0, 1), Steps=Slider(5, range=0..10))
# Fuerza de atracción
# entre los puntos
# (pueden ser distintas)
number_slider_6 = Slider(1.2, range=0..10)
point_charge = PointCharge(Point=pop3d, Radius=random, ChargeStrength=Slider(30, range=0..100))
tboxarray = TwistedBoxArray(Box=box_3, ParametersX=range, ParametersY=range_2, ParametersZ=range_3)
item_3 = ListItem(List=debrep.Faces, Index=Slider(0, range=0..5), Wrap=True)  # -> Item, Item1, Item2, Item3, Item4, Item5
srf = Surface(item_3.Item4)
# Forma corta
srf_2 = Surface(item_3.Item5)
# Escala de manera
# no uniforme, sino
# por coordenadas
# X Y Z
scale_nu = ScaleNU(
    Geometry=box,
    Plane=PlaneXY(0, 0, 0),
    ScaleX=Slider(1.7, range=0..10),
    ScaleY=Slider(1.7, range=0..10),
    ScaleZ=number_slider_6)  # -> Geometry, Transform
detbox = DeconstructTwistedBox(TwistedBox=tboxarray, DeconstructType=0)
# Si cocino esto
# también me cocina
# datos y se laguea más
# Que tan grandes son los
# triángulos del mesh
# (entre menor tamaño, mayor
# resolución)
toggle = BooleanToggle(True)

# ---- group: Crv :
crv = Curve(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)
divide = DivideCurve(Curve=crv, Count=Slider(100, range=0..100), Kinks=False)  # -> Points, Tangents, Parameters

# ----
number_slider_7 = Slider(6, range=0..10)
# Genera la malla
cocoon = Cocoon(Charges=point_charge, Iso=Slider(0.1, range=0..1), CellSize=Slider(70, range=1..500), Execute=toggle, Simple=False)  # -> Mesh, RefinementData
# Convierte Brep
# en malla
# (mesh brep)
mesh = MeshBrep(
    Brep=scale_nu.Geometry,
    Settings={GridMaxCount=0, GridMinCount=16, JaggedSeams=False, MaxEdgeLength=0, MinEdgeLength=0.0001, MinTolerance=0, Refine=True, RefineAngle=0, RelativeTolerance=0.65, SimplePlanes=True, Tolerance=0})
mesh_2 = Mesh(cocoon.Mesh)
pop2d = Populate2D(Region=srf_2, Count=number_slider_7, Seed=Slider(73, range=49..100))
pop2d_2 = Populate2D(Region=srf, Count=number_slider_7, Seed=Slider(6, range=1..49))
msplit = MeshSplit(Mesh=mesh_2, Splitters=mesh)

# ----
# Extraer la base (x,y,0)
# en la que están los ptos.
# (La base de la caja inicial)
debrep_2 = DeconstructBrep(Brep=box_3)  # -> Faces, Edges, Vertices
item_4 = ListItem(List=debrep_2.Faces, Index=0, Wrap=True)  # -> Item, Item1, Item2, Item3, Item4
srf_3 = Surface(item_4.Item4)

p_n_s = PinchNSpreadPoints(
    Points=detbox,
    Locations=divide.Points,
    Radii=Slider(1000, range=0..1000),
    Strengths=Slider(0.5, range=0..10),
    Falloffs=1,
    Exponents=1,
    Weights1=1,
    Weights2=0)
Z = UnitZ(Factor=Slider(1000, range=0..1000))

# ---- group: Srf a la que van ptos
# Ñe que hace que ptos
# se acerquen a la crv
crv_2 = Curve([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])
loft = Loft(Curves=crv_2, Options={Adjust=False, Closed=False, LoftEnds=0, LoftSimp=0, LoftType=0, Rebuild=10, Refit=0.01})

# ----
rev = Reverse(Vector=Z)
item_5 = ListItem(List=msplit, Index=Slider(0, range=0..10), Wrap=True)

# ---- group: Radios randoms
dom_2 = ConstructDomain(DomainStart=Slider(200, range=0..1000), DomainEnd=Slider(600, range=0..1000))
random_2 = Random(Range=dom_2, Number=number_slider_7, Seed=Slider(1000, range=0..1000))

# ----
# Ptos deben tener
# mismo sentido pero
# distinta dirección para
# este tipo de Crv
bzspan = BezierSpan(StartPoint=pop2d_2, StartTangent=Z, EndPoint=pop2d, EndTangent=rev)  # -> Curve, Length, Domain
mappt2srf = MapPointToSurface(Point=p_n_s, Source=srf_3, Target=loft)
# "suavizar malla"
qrmesh = QuadRemesh(Mesh=item_5, Settings={aqc=True, as=50, dhe=True, gci=0, null=False, pme=0, sa=0, tqc=2000})
# "Tú, componente que está inmersa en una caja de 8 vértices,
# métete a esta otra srf con 8 vértices"
# 
# Dijo Jesucristo
cotbox = ConstructTwistedBox(Corners=mappt2srf)

mesh_3 = Mesh(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)
bbox = BoundingBox(Content=mesh_3, Plane=PlaneXY(0, 0, 0))  # -> Box, Box_2

# ----
# grosor de malla
wbthicken = WeaverbirdsMeshThicken(MeshCurves=qrmesh, Distance=Slider(50, range=0..100), OffsetType=0)
curve_charge = CurveCharge(Curve=bzspan.Curve, Radius=random_2, ChargeStrengths=Slider(1, range=0..1))
morph = BoxMorph(Geometry=mesh_3, Reference=bbox.Box, Target=cotbox)
scale_nu_2 = ScaleNU(
    Geometry=box_2,
    Plane=PlaneXY(0, 0, 0),
    ScaleX=Slider(1.3, range=0..10),
    ScaleY=Slider(0.7, range=0..10),
    ScaleZ=Slider(0.8, range=0..10))  # -> Geometry, Transform
Z_2 = UnitZ(Factor=Slider(30, range=0..100))
# I (target iso value) es
# como la resolución
# (que tan preciso queda)
toggle_2 = BooleanToggle(True)
mjoin = MeshJoin(Meshes=morph)
contour = Contour(Shape=wbthicken, Point=Point(0, 0, 0), Direction=Vector(0, 0, 1), Distance=Z_2)
cocoon_2 = Cocoon(Charges=curve_charge, Iso=Slider(0.1, range=0..0.1), CellSize=Slider(100, range=0..100), Execute=toggle_2, Simple=False)  # -> Mesh, RefinementData
mesh_4 = MeshBrep(
    Brep=scale_nu_2.Geometry,
    Settings={GridMaxCount=0, GridMinCount=16, JaggedSeams=False, MaxEdgeLength=0, MinEdgeLength=0.0001, MinTolerance=0, Refine=True, RefineAngle=0, RelativeTolerance=0.65, SimplePlanes=True, Tolerance=0})
wbcatmullclark = WeaverbirdsCatmullClarkSubdivision(MeshCurves=mjoin, Level="3", SmoothNakedEdges=1)
boundary = BoundarySurfaces(Edges=contour)
mesh_5 = Mesh(cocoon_2.Mesh)
mint = MeshIntersection(MeshesA=mesh_5, MeshesB=mesh_4)
msplit_2 = MeshSplit(Mesh=mesh_5, Splitters=mesh_4)
extr = Extrude(Base=boundary, Direction=Z_2)
neg = Negative(Value=Slider(1755, range=0..5000))
X = UnitX(Factor=neg)
move = Move(Geometry=wbcatmullclark, Motion=X)  # -> Geometry, Transform
# Queda como sólido
qrmesh_2 = QuadRemesh(Mesh=mint, Settings={aqc=True, as=50, dhe=True, gci=0, null=False, pme=0, sa=0, tqc=2000})
item_6 = ListItem(List=msplit_2, Index=Slider(1, range=0..10), Wrap=True)
qrmesh_3 = QuadRemesh(Mesh=item_6, Settings={aqc=True, as=50, dhe=True, gci=0, null=False, pme=0, sa=0, tqc=2000})
number_slider_8 = Slider(40, range=0..100)
wbthicken_2 = WeaverbirdsMeshThicken(MeshCurves=qrmesh_3, Distance=Slider(31, range=0..100), OffsetType=0)

Y = UnitY(Factor=1)
# Variaciones de corte
X_2 = UnitX(Factor=1)

Y_2 = UnitY(Factor=number_slider_8)
Z_3 = UnitZ(Factor=number_slider_8)
contour_2 = Contour(Shape=wbthicken_2, Point=Point(0, 0, 0), Direction=Vector(0, 0, 1), Distance=Z_3)
boundary_2 = BoundarySurfaces(Edges=contour_2)
extr_2 = Extrude(Base=boundary_2, Direction=Z_3)
join = BrepJoin(Breps=extr_2)  # -> Breps, Closed
neg_2 = Negative(Value=Slider(-4200, range=-4201..-4200))
X_3 = UnitX(Factor=neg_2)
move_2 = Move(Geometry=join.Breps, Motion=X_3)  # -> Geometry, Transform
