# Grasshopper definition uai_3_pd_galapagos.gh (Grasshopper 1.0.7)

# Isovistas
# 
# 
# 
# 
# 2D:
number_slider = Slider(5500, range=0..10000)
jorge = Rectangle(Plane=PlaneXY(0, 0, 0), XSize=number_slider, YSize=Slider(3500, range=0..10000), Radius=0)  # -> Rectangle, Length
# = PlanarSrf
boundary = BoundarySurfaces(Edges=jorge.Rectangle)
geo = Geometry([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])
# "Trim"
# Separa las srf
srfsplit = SurfaceSplit(Surface=boundary, Curves=geo)
# Area de cada
# srf cortada
area = Area(Geometry=srfsplit)  # -> Area, Centroid
panel = Panel(area.Area)
# Di vuelta el orden
# de la lista
rev = ReverseList(List=area.Area)
panel_2 = Panel(rev)
# Ordena lista según
# un criterio
# (en este caso el área
# de las superficies)
sort = SortList(Keys=rev, ValuesA=srfsplit)  # -> Keys, ValuesA
item = ListItem(List=sort.ValuesA, Index=Slider(4, range=0..10), Wrap=True)
panel_3 = Panel(sort.Keys)
number_slider_2 = Slider(20, range=0..100)
number_slider_3 = Slider(20, range=0..100)
# Hay que eliminar los nulls
# (son las coordenadas de las
# grillas, en donde en los espacios
# vacíos no hay nada)
# Grilla con puntos, pero existen
# algunos que están en los límites
# de la srf (como en la pared)
sdivide = DivideSurface(Surface=item, UCount=number_slider_2, VCount=number_slider_2)  # -> Points, Normals, Parameters
panel_4 = Panel(sdivide.Points)
# (Que maravilla de
# comando xd)
clean = CleanTree(RemoveNulls=True, RemoveInvalid=True, RemoveEmpty=False, Tree=sdivide.Points)
panel_5 = Panel(clean)
# Calcula dist. entre pts
# y geometrías
pull = PullPoint(Point=flatten(clean), Geometry=jorge.Rectangle, ClosestOnly=True)  # -> ClosestPoint, Distance
smaller = SmallerThan(FirstNumber=pull.Distance, SecondNumber=Slider(0.1, range=0..0.1))  # -> SmallerThan, OrEqualTo
panel_6 = Panel(smaller.SmallerThan)
dispatch = Dispatch(List=flatten(clean), DispatchPattern=smaller.SmallerThan)  # -> ListA, ListB
number_slider_4 = Slider(38, range=0..303)
pt = Point(dispatch.ListA)
pt_2 = Point(dispatch.ListB)
item_2 = ListItem(List=pt_2, Index=number_slider_4, Wrap=True)
ivist = IsoVist(Plane=item_2, Count=Slider(37, range=1..100), Radius=Slider(6026, range=1..10000), Obstacles=[jorge.Rectangle, geo])  # -> Points, Distance, Index
ln = Line(StartPoint=item_2, EndPoint=ivist.Points)
# Optimización
# Se suman todos los
# largos de las líneas.
# 
# Por ende, la suma
# más grande da el
# mayor campo de
# visión.
len = Length(Curve=ln)
ma = MassAddition(Input=len)  # -> Result, PartialResults
# Posibles ñes iniciales
# Lo que quiero lograr
galapagos = Galapagos(fitness=ma, gene=number_slider_4)
