# Grasshopper definition uai_3_pd_loft.gh (Grasshopper 1.0.7)
# plug-ins: Pufferfish, Weaverbird, ShapeDiver

# Por general, sillas varían entre
# 30 y 50 cm
pt_a = ConstructPoint(XCoordinate=0, YCoordinate=0, ZCoordinate=0)

izq_alto = Slider(460, range=380..550)
izq_largo = Slider(496, range=380..550)
ancho_frente = Slider(435, range=380..550)
grosor = Slider(21, range=5..50)
frente_alto = Slider(447, range=380..550)
respaldo_altura = Slider(725, range=550..1100)
ass = Slider(190, range=0..400)

X = UnitX(Factor=ancho_frente)
Y = UnitY(Factor=izq_largo)
pt_c = Move(Geometry=pt_a, Motion=X)  # -> Geometry, Transform
pt_c2 = Move(Geometry=pt_a, Motion=Y)  # -> Geometry, Transform
ln = Line(StartPoint=pt_a, EndPoint=pt_c2.Geometry)
ln_2 = Line(StartPoint=pt_a, EndPoint=pt_c.Geometry)
# Al reparametrizar, el 0 es
# el inicio y 1 el final
# (como si se pasara a %)
eval = EvaluateCurve(Curve=reparameterize(ln_2), Parameter="0.5")  # -> Point, Tangent, Angle
eval_2 = EvaluateCurve(Curve=reparameterize(ln), Parameter="0.5")  # -> Point, Tangent, Angle
Z = UnitZ(Factor=frente_alto)
Z_2 = UnitZ(Factor=izq_alto)
pt_b = Move(Geometry=eval.Point, Motion=Z)  # -> Geometry, Transform
pt_b2 = Move(Geometry=eval_2.Point, Motion=Z_2)  # -> Geometry, Transform
intcrv = Interpolate(Vertices=[pt_a, pt_b.Geometry, pt_c.Geometry], Degree=3, Periodic=False, KnotStyle=1)  # -> Curve, Length, Domain
intcrv_2 = Interpolate(Vertices=[pt_a, pt_b2.Geometry, pt_c2.Geometry], Degree=3, Periodic=False, KnotStyle=1)  # -> Curve, Length, Domain
yz = YZPlane(Origin=eval.Point)
mirror = Mirror(Geometry=intcrv_2.Curve, Plane=yz)  # -> Geometry, Transform
eval_3 = EvaluateCurve(Curve=reparameterize(mirror.Geometry), Parameter="0.5")  # -> Point, Tangent, Angle
end = EndPoints(Curve=mirror.Geometry)  # -> Start, End
pt_c3 = Point(end.End)
ln_3 = Line(StartPoint=pt_c2.Geometry, EndPoint=pt_c3)
eval_4 = EvaluateCurve(Curve=reparameterize(ln_3), Parameter="0.5")  # -> Point, Tangent, Angle
Z_3 = UnitZ(Factor=respaldo_altura)
pt_b2_2 = Move(Geometry=eval_4.Point, Motion=Z_3)  # -> Geometry, Transform
intcrv_3 = Interpolate(Vertices=[pt_c2.Geometry, pt_b2_2.Geometry, pt_c3], Degree=3, Periodic=False, KnotStyle=1)  # -> Curve, Length, Domain
ln_4 = Line(StartPoint=pt_b2.Geometry, EndPoint=eval_3.Point)
eval_5 = EvaluateCurve(Curve=reparameterize(ln_4), Parameter="0.5")  # -> Point, Tangent, Angle
Z_4 = UnitZ(Factor=ass)
neg = Negative(Value=Z_4)
pt_b2_3 = Move(Geometry=eval_5.Point, Motion=neg)  # -> Geometry, Transform
intcrv_4 = Interpolate(Vertices=[pt_b.Geometry, pt_b2_3.Geometry, pt_b2_2.Geometry], Degree=3, Periodic=False, KnotStyle=1)  # -> Curve, Length, Domain
intcrv_5 = Interpolate(Vertices=[pt_b2.Geometry, pt_b2_3.Geometry, eval_3.Point], Degree=3, Periodic=False, KnotStyle=1)  # -> Curve, Length, Domain
ass_respaldo = Curve(intcrv_4.Curve)
crv_izq = Curve(intcrv_2.Curve)
crv_frente = Curve(intcrv.Curve)
ass_lados = Curve(intcrv_5.Curve)
crv_der = Curve(mirror.Geometry)
crv_respaldo = Curve(intcrv_3.Curve)
netsurf = NetworkSurface(CurvesU=[crv_izq, ass_respaldo, crv_der], CurvesV=[crv_frente, ass_lados, crv_respaldo], Continuity=2)
mesh = MeshBrep(
    Brep=netsurf,
    Settings={GridMaxCount=0, GridMinCount=16, JaggedSeams=False, MaxEdgeLength=0, MinEdgeLength=0.0001, MinTolerance=0, Refine=True, RefineAngle=0, RelativeTolerance=0.65, SimplePlanes=True, Tolerance=0})
wbthicken = WeaverbirdsMeshThicken(MeshCurves=mesh, Distance=grosor, OffsetType=0)
offmsh = OffsetMesh(Mesh=mesh, Distance=grosor, BothSides=0, CreateSolid=True)  # disabled
sdsimplematerial = ShapeDiverSimpleMaterial(Color=RGB(255, 255, 255), MaterialIndex=1)
sddisplaygeometry = ShapeDiverDisplayGeometry(Geometry=wbthicken, ShapeDiverMaterial=sdsimplematerial)
sdexportdownload = ShapeDiverExportDownload(Data=wbthicken, Format="stl", Name="Ale_Cifuentes_Silla_Param")
