# Grasshopper definition uai_3_pd_metaball.gh (Grasshopper 1.0.7)

# ---- group: Planos cortadores
# Dim de planchas
# de madera prom.
number_slider = Slider(111, range=0..1000)
neg = Negative(Value=number_slider)
pt = ConstructPoint(XCoordinate=0, YCoordinate=0, ZCoordinate=neg)
number_slider_2 = Slider(18, range=0..100)
xy = XYPlane(Origin=pt)
Z = UnitZ(Factor=number_slider_2)
# Carga y potencia
arrlinear = LinearArray(Geometry=xy, Direction=Z, Count=Slider(30, range=0..100))  # -> Geometry, Transform

# ----
# MetaBall
number_slider_3 = Slider(1220, range=0..10000)
rectangle = Rectangle(Plane=PlaneXY(0, 0, 0), XSize=number_slider_3, YSize=Slider(2440, range=0..10000), Radius=0)  # -> Rectangle, Length
pt_2 = Point([Point(820.920564, 876.1163865, 0), Point(252.7719005, 205.1351155, 0), Point(992.9866508, 364.8037215, 0), Point(1070.310896, 1354.071623, 0), Point(590.5957666, 1944.043106, 0), Point(198.624676, 1508.565519, 0), Point(245.0215091, 954.0631778, 0)])
genes = GenePool(Decimals=1, Maximum=50000, Minimum=10000, Value=[15931.4, 38676, 15875, 43338.8, 21404, 10000, 19181.8])
# Redondea valores
round = Round(Number=genes)  # -> Nearest, Floor, Ceiling
# Con muchos ptos y no
# es una curva suave
# (todo mal xd)
metaball_t = MetaBallTCustom(Points=pt_2, Charge=genes, Plane=arrlinear.Geometry, Threshold=0.5)
multiplication = Multiplication(A=genes, B=Slider(0.8, range=0..1))
panel = Panel(round.Floor)
metaball_t_2 = MetaBallTCustom(Points=pt_2, Charge=multiplication, Plane=arrlinear.Geometry, Threshold=0.5)
reb = RebuildCurve(Curve=metaball_t, Degree="3", Count=Slider(70, range=0..200), Tangents=False)
reb_2 = RebuildCurve(Curve=metaball_t_2, Degree="3", Count=Slider(70, range=0..200), Tangents=False)
# Volumen, pero por
# dentro vacío
# (amarillo pero no está malo)
boundary = BoundarySurfaces(Edges=[reb, reb_2])
Z_2 = UnitZ(Factor=number_slider_2)
extr = Extrude(Base=boundary, Direction=Z_2)
