# Grasshopper definition uai_3_pd_srf_catenaria.gh (Grasshopper 1.0.7)
# plug-ins: Weaverbird, Kangaroo2 Components

# Clase_2
# Catenaria (que épico)
number_slider = Slider(200, range=100..400)
# Construccion del plano
planesrf = PlaneSurface(Plane=PlaneXY(0, 0, 0), XSize=number_slider, YSize=Slider(200, range=100..400))
mplane = MeshPlane(Boundary=planesrf, WidthCount=Slider(10, range=1..20), HeightCount=Slider(10, range=1..20))  # -> Mesh, Area
# Gene pool
genes = GenePool(Decimals=0, Maximum=120, Minimum=0, Value=[48, 57.096, 89, 34, 73])
# Extracción de partes del plano
wbedges = WeaverbirdsMeshEdges(MeshOrPolylines=mplane.Mesh)
demesh = DeconstructMesh(Mesh=mplane.Mesh)  # -> Vertices, Faces, Colours, Normals
# Esquinas seleccionadas
# para fijar
mc = MeshCorners(Mesh=mplane.Mesh, Angle=2.35619449)
# Número del largo
# de las líneas extraidas
# de la malla
len = Length(Curve=wbedges)
Z = UnitZ(Factor=1)
# Punto "i" seleccionado
# para fijar
item = ListItem(
    List=demesh.Vertices,
    Index=[genes, Slider(47, range=0..120), Slider(71, range=0..120), Slider(48, range=0..120), Slider(91, range=0..120)],
    Wrap=True)
item_2 = ListItem(List=demesh.Vertices, Index=0, Wrap=True)
points = PointList(Points=demesh.Vertices, Size=Slider(4, range=0..10))
neg = Negative()
# fuerzas y restricciones
# (goals)
length_line = LengthLine(Line=wbedges, Length=len, Strength=10)
# Carga (que será aplicada
# en los vertices de la malla)
anchor = Anchor(Point=[mc, item, item_2], Strength=10000)
load = Load(Point=demesh.Vertices, ForceVector=Z, Weighting=1)
# Ancla
show = Show(G=mplane.Mesh)
# Visualización
merge = Merge(Data1=length_line, Data2=load, Data3=anchor, Data4=show)
bouncysolver = BouncySolver(GoalObjects=merge, Reset=Toggle(False), Threshold=1e-15, Tolerance=0.01, Damping=0.99, Iterations=10, On=Toggle(False))  # -> I, V, O
# De los puntos, líneas y
# mallas, solo selecciona las
# mallas (no es que esté malo)
mesh = Mesh(bouncysolver.O)
# Triangulización
tri = Triangulate(Mesh=mesh)  # -> Mesh, Count
