# Grasshopper definition uai_3_pd_srf_extr.gh (Grasshopper 1.0.7)

neg = Negative(Value=Slider(1594, range=0..2000))
neg_2 = Negative(Value=Slider(389.744186, range=0..1000))
# 3) Random
pt = ConstructPoint(XCoordinate=0, YCoordinate=Slider(1295.51, range=0..1500), ZCoordinate=0)
# 1) Líneas
number_slider = Slider(1000, range=0..5000)
# 4) Pirámides
pt_2 = ConstructPoint(XCoordinate=neg, YCoordinate=0, ZCoordinate=0)
# 2) Geometrías
pt_3 = ConstructPoint(XCoordinate=0, YCoordinate=neg_2, ZCoordinate=0)
xz = XZPlane(Origin=pt)
number_slider_2 = Slider(500, range=0..1000)
xz_2 = XZPlane(Origin=pt_3)
number_slider_3 = Slider(15, range=0..15)
xy = XYPlane(Origin=pt_2)
planesrf = PlaneSurface(Plane=PlaneXY(0, 0, 0), XSize=number_slider, YSize=number_slider)
number_slider_4 = Slider(10, range=0..10)
number_slider_5 = Slider(10, range=0..10)
planesrf_2 = PlaneSurface(Plane=xz_2, XSize=Slider(1000, range=0..1000), YSize=Slider(1000, range=0..1000))
# 5) Esfera random
pt_4 = ConstructPoint(XCoordinate=number_slider_2, YCoordinate=number_slider_2, ZCoordinate=Slider(800, range=0..2000))
# Puede ser pto, crv, o cualquier geometría
divide = DivideDomain²(Domain=planesrf, UCount=number_slider_3, VCount=number_slider_3)
planesrf_3 = PlaneSurface(Plane=xz, XSize=Slider(1000, range=0..1000), YSize=Slider(1000, range=0..1000))
Y = UnitY(Factor=neg_2)
planesrf_4 = PlaneSurface(Plane=xy, XSize=Slider(1000, range=0..1000), YSize=Slider(1000, range=0..1000))
divide_2 = DivideDomain²(Domain=planesrf_2, UCount=number_slider_4, VCount=number_slider_4)
geo = Geometry([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, Point(790.3164364, 0, 594.4698463), Point(650.5744904, 0, 280.0504679), Point(135.2760646, 0, 489.6633869)])
crv = Curve()
pt_5 = Point()
divide_3 = DivideDomain²(Domain=planesrf_3, UCount=number_slider_5, VCount=number_slider_5)
number_slider_6 = Slider(8, range=0..10)
subsrf = Isotrim(Surface=planesrf, Domain=divide)
number_slider_7 = Slider(10, range=0..10)
move = Move(Geometry=geo, Motion=Y)  # -> Geometry, Transform
subsrf_2 = Isotrim(Surface=planesrf_2, Domain=divide_2)
sph = Sphere(Base=pt_4, Radius=Slider(400, range=0..1000))
lng = ListLength(List=divide_3)
subsrf_3 = Isotrim(Surface=planesrf_3, Domain=divide_3)
crv_2 = Curve(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)
area = Area(Geometry=subsrf)  # -> Area, Centroid
# La distancia del extrude es la distancia
# del centro del panel a la geometría (pto más cercano)
geo_2 = Geometry([<curve referenced from the Rhino model>, <point referenced from the Rhino model> x2])
pt_6 = Point()
area_2 = Area(Geometry=subsrf_2)  # -> Area, Centroid
divide_4 = DivideDomain²(Domain=sph, UCount=number_slider_6, VCount=number_slider_6)
random = Random(Range="1 TO 300", Number=lng, Seed=Slider(67, range=0..100))
divide_5 = DivideDomain²(Domain=planesrf_4, UCount=number_slider_7, VCount=number_slider_7)
pull = PullPoint(Point=area.Centroid, Geometry=crv_2, ClosestOnly=True)  # -> ClosestPoint, Distance
pull_2 = PullPoint(Point=area_2.Centroid, Geometry=move.Geometry, ClosestOnly=True)  # -> ClosestPoint, Distance
# Puede ser pto, crv, o
# cualquier geometría
X = UnitX(Factor=neg)
subsrf_4 = Isotrim(Surface=sph, Domain=divide_4)
subsrf_5 = Isotrim(Surface=planesrf_4, Domain=divide_5)
Y_2 = UnitY(Factor=random)
Z = UnitZ(Factor=pull.Distance)
panel = Panel(pull.Distance)
panel_2 = Panel(pull_2.Distance)
panel_3 = Panel(random)
Y_3 = UnitY(Factor=pull_2.Distance)
area_3 = Area(Geometry=subsrf_4)  # -> Area, Centroid
wires = BrepWireframe(Brep=subsrf_4, Density=-1)
neg_3 = Negative(Value=Y_2)
crv_3 = Curve(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)
area_4 = Area(Geometry=subsrf_5)  # -> Area, Centroid
extr = Extrude(Base=subsrf, Direction=Z)
extr_2 = Extrude(Base=subsrf_2, Direction=Y_3)
bnd = Bounds(Numbers=pull_2.Distance)
extr_3 = Extrude(Base=subsrf_3, Direction=neg_3)
move_2 = Move(Geometry=crv_3, Motion=X)  # -> Geometry, Transform
dedomain = DeconstructDomain(Domain=bnd)  # -> Start, End
srf_cp = SurfaceClosestPoint(Point=area_3.Centroid, Surface=subsrf_4)  # -> Point, UVPoint, Distance
pull_3 = PullPoint(Point=area_4.Centroid, Geometry=move_2.Geometry, ClosestOnly=True)  # -> ClosestPoint, Distance
bnd_2 = Bounds(Numbers=panel_3)
panel_4 = Panel(dedomain.End)
bnd_3 = Bounds(Numbers=pull.Distance)
panel_5 = Panel(dedomain.Start)
dom = ConstructDomain(DomainStart=Slider(0.22, range=0.09..0.9), DomainEnd=Slider(0.8, range=0.1..1.1))
join = JoinCurves(Curves=wires, Preserve=False)  # -> flatten(Curves)
dedomain_2 = DeconstructDomain(Domain=bnd_2)  # -> Start, End
dedomain_3 = DeconstructDomain(Domain=bnd_3)  # -> Start, End

# ---- group: Vector normal
evalsrf = EvaluateSurface(Surface=subsrf_4, Point=srf_cp.UVPoint)  # -> Point, Normal, UDirection, VDirection, Frame
dom_2 = ConstructDomain(DomainStart=Slider(59, range=15..100), DomainEnd=Slider(134, range=0..200))
lng_2 = ListLength(List=subsrf_4)
random_2 = Random(Range=dom_2, Number=lng_2, Seed=Slider(87, range=0..100))
amp = Amplitude(Vector=evalsrf.Normal, Amplitude=random_2)  # -> graft(Vector)

# ----
panel_6 = Panel(pull_3.Distance)
lng_3 = ListLength(List=subsrf_4)
gradient = Gradient(
    LowerLimit=Slider(10, range=0..10),
    UpperLimit=Slider(200, range=0..1000),
    Parameter=pull_2.Distance,
    stops=[0: RGB(234, 38, 0), 0.25: RGB(234, 126, 0), 0.5: RGB(254, 244, 84), 0.75: RGB(173, 203, 249), 1: RGB(75, 107, 169)])
panel_7 = Panel(dedomain_3.End)
panel_8 = Panel(dedomain_2.End)
panel_9 = Panel(dedomain_2.Start)
# Previsualización
panel_10 = Panel(dedomain_3.Start)
gradient_2 = Gradient(
    LowerLimit=Slider(10, range=0..10),
    UpperLimit=Slider(200, range=0..1000),
    Parameter=panel_3,
    stops=[0: RGB(80, 55, 25), 0.5: RGB(159, 65, 29), 1: RGB(174, 166, 129)])
division = Division(A=pull_3.Distance, B=Slider(681, range=0..1000))
random_3 = Random(Range=dom, Number=lng_3, Seed=Slider(100, range=0..100))
scale = Scale(Geometry=subsrf_5, Center=area_4.Centroid, Factor=division)  # -> Geometry, Transform
scale_2 = Scale(Geometry=join, Center=area_3.Centroid, Factor=random_3)  # -> Geometry, Transform
subtraction = Subtraction(A=random_3, B=Slider(0.1, range=0..0.1))
gradient_3 = Gradient(
    LowerLimit=Slider(10, range=0..10),
    UpperLimit=Slider(200, range=0..1000),
    Parameter=pull.Distance,
    stops=[0: RGB(255, 255, 255), 1: RGB(0, 0, 0)])
preview = CustomPreview(Geometry=extr_2, Material=gradient)
scale_3 = Scale(Geometry=join, Center=area_3.Centroid, Factor=subtraction)  # -> Geometry, Transform

vdis = VectorDisplay(Anchor=evalsrf.Point, Vector=evalsrf.Normal)

rotate = Rotate(Geometry=scale.Geometry, Angle=degrees(pull_3.Distance), Plane=area_4.Centroid)  # -> Geometry, Transform
preview_2 = CustomPreview(Geometry=extr_3, Material=gradient_2)
Z_2 = UnitZ(Factor=pull_3.Distance)
merge = Merge(Data1=simplify(graft(scale_3.Geometry)), Data2=simplify(graft(scale_2.Geometry)))
merge_2 = Merge(Data1=simplify(graft(join)), Data2=simplify(graft(scale_2.Geometry)))
move_3 = Move(Geometry=rotate.Geometry, Motion=Z_2)  # -> Geometry, Transform
preview_3 = CustomPreview(Geometry=extr, Material=gradient_3)
wires_2 = BrepWireframe(Brep=subsrf_5, Density=-1)
wires_3 = BrepWireframe(Brep=move_3.Geometry, Density=-1)
loft = Loft(Curves=merge_2, Options={Adjust=False, Closed=False, LoftEnds=0, LoftSimp=0, LoftType=0, Rebuild=10, Refit=0.01})
loft_2 = Loft(Curves=merge, Options={Adjust=False, Closed=False, LoftEnds=0, LoftSimp=0, LoftType=0, Rebuild=10, Refit=0.01})
join_2 = JoinCurves(Curves=wires_3, Preserve=False)
join_3 = JoinCurves(Curves=wires_2, Preserve=False)
extr_4 = Extrude(Base=loft_2, Direction=amp)
loft_3 = Loft(Curves=[join_3, join_2], Options={Adjust=True, Closed=False, LoftEnds=0, LoftSimp=0, LoftType=0, Rebuild=10, Refit=0.01})
preview_4 = CustomPreview(
    Geometry=[extr_4, loft],
    Material={diffuse=RGB(221, 160, 221), emission=RGB(66, 48, 66), shine=0.5, specular=RGB(255, 255, 255), transparency=0})
# (En construcción)
preview_5 = CustomPreview(
    Geometry=loft_3,
    Material={diffuse=RGB(221, 160, 221), emission=RGB(66, 48, 66), shine=0.5, specular=RGB(255, 255, 255), transparency=0})
