# Grasshopper definition uai_3_pd_vorsrf.gh (Grasshopper 1.0.7)
# plug-ins: Kangaroo2 Components, Topologizer

srf = Surface(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)
edges = BrepEdges(Brep=srf)  # -> Naked, Interior, NonManifold
project = Project(Geometry=edges.Naked, Plane=PlaneXY(0, 0, 0))  # -> Geometry, Transform
panel = Panel(edges.Naked)
boundary = BoundarySurfaces(Edges=project.Geometry)
box = Box(srf)
popgeo = PopulateGeometry(Geometry=boundary, Count=Slider(100, range=0..100), Seed=Slider(3, range=0..10))
area = Area(Geometry=box)  # -> Area, Centroid
Z = UnitZ(Factor=1)
scale = Scale(Geometry=box, Center=area.Centroid, Factor="1.5")  # -> Geometry, Transform
project_2 = ProjectPoint(Point=popgeo, Direction=Z, Geometry=srf)  # -> Point, Index
voronoi³ = Voronoi3D(Points=project_2.Point, Box=scale.Geometry)  # -> Cells, Boundary
srf_2 = Surface(srf)
dom = ConstructDomain(DomainStart=0, DomainEnd=1)
bbx = BrepBrep(BrepA=voronoi³.Cells, BrepB=srf_2)  # -> Curves, Points
explode = Explode(Curve=bbx.Curves, Recursive=True)  # -> Segments, Vertices
subcrv = SubCurve(BaseCurve=reparameterize(bbx.Curves), Domain=dom)
end = EndPoints(Curve=explode.Segments)  # -> Start, End
ln = Line(StartPoint=end.Start, EndPoint=end.End)
topo = Topologizer(LinesInput=flatten(ln), Tolerance=Slider(0.675, range=0..1))  # -> L, P, S, E, N, I, O, G
mp = MultiPipe(Curves=flatten(topo.L), NodeSize=0.5, EndOffset=1, StrutSize=1, Segment=0, KinkAngle=0.6, CubeFit=0)
preview = CustomPreview(
    Geometry=mp,
    Material={diffuse=RGB(221, 160, 221), emission=RGB(66, 48, 66), shine=0.5, specular=RGB(255, 255, 255), transparency=0})
